# Grasshopper definition dev.ghx (Grasshopper 1.0.7)

crv = Curve([<curve referenced from the Rhino model> x8])
pt = Point(Point(957.2978759, -124.9300902, 0))
pt_2 = Point(Point(416.2228059, -1036.636699, 0))

# ---- group: Test_NurbsCurve
crv_2 = Curve(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)

# ---- group: Test PolyLine
crv_3 = Curve(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)

# ---- group: Calibration
python = GhPythonScript(TOOL=pt, COLOR=pt_2, COLOR_LENGTH=Slider(36, range=0..100), EXPORT=Button())  # -> out, PREVIEW
# ---------- python: Python ----------
import rhinoscriptsyntax as rs


def draw_pt(pt, vecx, count):
    
    pts = []
    
    for i in xrange(count):
        
        pts.append(rs.PointAdd(pt, rs.CreateVector(vecx * i, 0, 0)))
        
    return pts


def join_item(list):
    
    txt = ",".join(list)
    txt += "\n"
    return txt


def join_list(list):
    
    txt = "".join(list)
    return txt


def xyz_to_uv(pt):
    
    ### Convert Rhino_XYZ to Screen_UV
    
    point = rs.coerce3dpoint(pt)
    # print(point)
    
    u = str(int(abs(point.X)))
    # print(point.X, u)

    v = str(int(abs(point.Y)))
    # print(point.Y, v)
    
    return u, v



def define_tool(pt):
    
    tool_pos = xyz_to_uv(pt)
    # print(tool_pos)
    
    return tool_pos


def define_color(pt):
    
    color_pos = xyz_to_uv(pt)
    # print(color_pos)
    
    return color_pos


def define(tool_pt, color_pt, color_length):
    
    define_out = []
    
    ### Define Tool
    tool_uv = define_tool(tool_pt)
    tool_uv_f = "uv_tool, {}, {}\n".format(tool_uv[0], tool_uv[1])
    define_out.append(tool_uv_f)
    
    ### Define Color    
    for i in xrange(8):
        point = rs.coerce3dpoint(color_pt)
        
        ### Calc Colors
        color_point = rs.AddPoint(point.X + color_length * i, point.Y, point.Z)
        color_uv = define_color(color_point)
        color_uv_f = "uv_color_{}, {}, {}\n".format(i+1, color_uv[0], color_uv[1])
        define_out.append(color_uv_f)
    
    define_joined = join_list(define_out)
    
    return define_joined


def export(path, txt):

    ### Export
    with open(path, 'w') as f:
        f.write(txt)



### Set Path
path = r"C:\Users\yoshioca\Documents\Tajima_Sai_Automation\data\tools.txt"
path = r"C:\Users\ysoky\Documents\Tajima_Sai_Automation\data\tools.txt"


# print(path)

PREVIEW = draw_pt(COLOR, COLOR_LENGTH, 8)

list_defined = define(TOOL, COLOR, COLOR_LENGTH)
# print(list_defined)


if EXPORT:
    
    export(path, list_defined)
# ---------- end python ----------

# ----
panel = Panel(pt)

# ---- group: NurbsCurve to Polyline
python_2 = GhPythonScript(NURBS_CURVE=crv, RESOLUTION="10")  # -> out, POLYLINES; inputs NURBS_CURVE: list
# ---------- python_2: Python ----------
import Rhino.Geometry as rg
import rhinoscriptsyntax as rs
import ghpythonlib.components as ghpc


crv_src = NURBS_CURVE
resolution = int(RESOLUTION)

crv_out = []


def nurbs_to_polyline(crv_guid, res):
    
    crv = rs.coercecurve(crv_guid)
    
    len_ = ghpc.Length(crv)

    split_count = int(len_ / res)
    # print(split_count)
    
    pts, t0, t1 = ghpc.DivideCurve(crv, split_count, False)
    
    pl = ghpc.PolyLine(pts, False)
    
    ### Down Sampling
    pl_ds, _smp = ghpc.SimplifyCurve(pl, 5)
    
    
    return pl_ds


for i in xrange(len(crv_src)):
    
    pl = nurbs_to_polyline(crv_src[i], resolution)
    crv_out.append(pl)

POLYLINES = crv_out
# ---------- end python_2 ----------

# ----
panel_2 = Panel(python.PREVIEW)
merge = Merge(Data1=python_2.POLYLINES, Data2=crv_3)  # -> flatten(Result)
python_3 = GhPythonScript(POLYLINES=python_2.POLYLINES, COLOR_ID="5", EXPORT=Button())  # -> out, a; inputs POLYLINES: list
# ---------- python_3: Python ----------
import Rhino.Geometry as rg
import rhinoscriptsyntax as rs
import ghpythonlib.components as ghpc


def join_item(list):
    
    txt = ",".join(list)
    txt += "\n"
    return txt


def join_list(list):
    
    txt = "".join(list)
    return txt


def xyz_to_uv(pt):
    
    ### Convert Rhino_XYZ to Screen_UV
    
    point = rs.coerce3dpoint(pt)
    # print(point)
    
    u = str(int(abs(point.X)))
    # print(point.X, u)

    v = str(int(abs(point.Y)))
    # print(point.Y, v)
    
    return u, v


def polyline_to_uv(polylines):
    
    uv_list = []
    dbg = []
    joined = None
    
    for i in xrange(len(polylines)):
        
        verts = rs.PolylineVertices(pls[i])
        dbg.append(verts)
    
        sub = []
        
        for j in xrange(len(verts)):
            
            uu, vv = xyz_to_uv(verts[j])
            sub.append(uu)
            sub.append(vv)
        
        ### List to String
        sub_join = join_item(sub)
        # print(sub_join)
        
        uv_list.append(sub_join)
        
    return uv_list, dbg


def merge_uv_with_color(uv_list, color):
    
    merged = []
    
    for i in xrange(len(uv_list)):
        # print(i, uv_list[i])
        
        ### Create
        txt = "{}, {}".format(clr, uv_list[i])
#        print(txt)
        
        merged.append(txt)
    
    merged_join = join_list(merged)
    # print("Export :", merged_join)
    
    return merged_join


def export(path, txt):

    ### Export
    with open(path, 'w') as f:
        f.write(txt)



export_data = []
pls = POLYLINES
clr = COLOR_ID

calc_points, debug = polyline_to_uv(pls)
out_text = merge_uv_with_color(calc_points, clr)
# print(out_text)

a = debug

### Set Path
#path = r"C:\Users\yoshioca\Documents\Tajima_Sai_Automation\data\pos_{}.txt".format(clr)
path = r"C:\Users\ysoky\Documents\Tajima_Sai_Automation\data\pos_{}.txt".format(clr)

# print(path)


if EXPORT:
    
    export(path, out_text)
# ---------- end python_3 ----------
panel_3 = Panel(python_2.POLYLINES)
item = ListItem(List=python_3.a, Index=0, Wrap=True)  # -> Item, Item1, Item2, Item3, Item4, Item5, Item6, Item7
panel_4 = Panel(python_3.a)
flattenruntimelist = FlattenRunTimeList(LIST=item.Item5)  # -> ITEMS; inputs LIST: list
# ---------- flattenruntimelist: Python ----------
import rhinoscriptsyntax as rs

def flatten_runtime_list(list):
    all = []
    for i in xrange(len(list)):
        print(i)
        sub = list[i]
        for j in xrange(len(sub)):
            print(j)
            all.append(sub[j])
    return all

ITEMS = flatten_runtime_list(LIST)
# ---------- end flattenruntimelist ----------
flattenruntimelist_2 = FlattenRunTimeList(LIST=item.Item6)  # -> ITEMS; inputs LIST: list; same code as flattenruntimelist
flattenruntimelist_3 = FlattenRunTimeList(LIST=item.Item7)  # -> ITEMS; inputs LIST: list; same code as flattenruntimelist
flattenruntimelist_4 = FlattenRunTimeList(LIST=item.Item4)  # -> ITEMS; inputs LIST: list; same code as flattenruntimelist
flattenruntimelist_5 = FlattenRunTimeList(LIST=item.Item1)  # -> ITEMS; inputs LIST: list; same code as flattenruntimelist
flattenruntimelist_6 = FlattenRunTimeList(LIST=item.Item3)  # -> ITEMS; inputs LIST: list; same code as flattenruntimelist
flattenruntimelist_7 = FlattenRunTimeList(LIST=item.Item)  # -> ITEMS; inputs LIST: list; same code as flattenruntimelist
flattenruntimelist_8 = FlattenRunTimeList(LIST=item.Item2)  # -> ITEMS; inputs LIST: list; same code as flattenruntimelist
